test file "cruiseControlRBTCovTests"
  coverage: Decision, Condition

suite "Cruise Control Test Suite"

  case "Set Speed Test" [simulation]
    description: Test setting the speed.
    model cruiseControlRBTCovExample, harness cruise_control_test_harness
    input "td_setSpeed.mat", mapped to enable, brake, set, inc, dec, Actual speed -> speed (active)
    assessment "Set target speed": At any point of time, whenever set is true then, with no delay, target_speed == actual_speed must be true
      target_speed: signal cruise_control_test_harness/Output Conversion Subsystem, port 2
      actual_speed: signal cruise_control_test_harness/speed, port 1
      set: signal cruise_control_test_harness/set, port 1

  case "Brake Test" [simulation]
    model cruiseControlRBTCovExample, harness cruise_control_test_harness
    input "td_brake.mat", mapped to enable, brake, set, inc, dec, Actual speed -> speed (active)
    assessment "Brake disengages throttle": At any point of time, whenever brake is true then, with no delay, throttle == 0 must be true
      brake: signal cruise_control_test_harness/brake, port 1
      throttle: signal cruise_control_test_harness/Output Conversion Subsystem, port 1

  case "Activate Test" [simulation]
    model cruiseControlRBTCovExample, harness cruise_control_test_harness
    input "td_enable.mat", mapped to enable, brake, set, inc, dec, Actual speed -> speed (active)
    assessment "Activate": At any point of time, whenever enable & set & ~brake is true then, with no delay, active_control must be true
      enable: signal cruise_control_test_harness/enable, port 1
      brake: signal cruise_control_test_harness/brake, port 1
      set: signal cruise_control_test_harness/set, port 1
      active_control: signal cruise_control_test_harness/sldvdemo_cruise_control_rbt|cruiseControlRBTCovExample/Controller/Logical Operator, port 1

  case "Increment Test" [simulation]
    model cruiseControlRBTCovExample, harness cruise_control_test_harness
    input "td_increment.mat", mapped to enable, brake, set, inc, dec, Actual speed -> speed (active)
    assessment "Inc increases target speed": At any point of time, whenever increment is true then, with no delay, target_deriv == 100 must be true
    assessment "Throttle applied": At any point of time, whenever increment is true then, with no delay, throttle > 0 must be true
      increment: signal cruise_control_test_harness/inc, port 1
      target_deriv: signal cruise_control_test_harness/Discrete Derivative1, port 1
      throttle: signal cruise_control_test_harness/Output Conversion Subsystem, port 1

  case "Decrement Test" [simulation]
    model cruiseControlRBTCovExample, harness cruise_control_test_harness
    input "td_decrement.mat", mapped to enable, brake, set, inc, dec, Actual speed -> speed (active)
    assessment "Dec decreases target speed": At any point of time, whenever decrement is true then, with no delay, target_deriv == -100 must be true
    assessment "Negative throttle applied": At any point of time, whenever decrement is true then, with no delay, throttle < 0 must be true
      decrement: signal cruise_control_test_harness/dec, port 1
      throttle: signal cruise_control_test_harness/Output Conversion Subsystem, port 1
      target_deriv: signal cruise_control_test_harness/Discrete Derivative1, port 1

  case "Throttle Test" [simulation]
    description: Test setting the speed.
    model cruiseControlRBTCovExample, harness cruise_control_test_harness
    input "td_throttle.mat", mapped to enable, brake, set, inc, dec, Actual speed -> speed (active)
    input "td_throttle_updated.mat", mapped to enable, brake, set, inc, dec, Actual speed -> speed
    assessment "Throttle rate within limits": At any point of time, throttle_deriv must be greater than -1 and less than 1
      throttle_deriv: signal cruise_control_test_harness/Discrete Derivative, port 1