% Requirement links of cruiseControlRBTCovTests.mldatx (R2024b)

item 1 verifies cruiseControlRBTCovReqs.slreqx#4: INCREMENT: INCREMENT button increases set speed
item 2 verifies cruiseControlRBTCovReqs.slreqx#2: BRAKE: BRAKE disengages cruise control
item 3 verifies cruiseControlRBTCovReqs.slreqx#3: ACTIVATE: ACTIVATE cruise control when enabled, speed set, and no brake
item 4 verifies cruiseControlRBTCovReqs.slreqx#1: SET_SPEED SET button locks set speed
item 4 verifies LiveDoc_Polarion-LVO_CruiseControl_Requirements_Cruise Control Requirement Specification.slreqx#27: CC-818 The system shall allow the user to set a target speed for the vehicle.
item 5 verifies cruiseControlRBTCovReqs.slreqx#6: THROTTLE: THROTTLE applied smoothly if speed differs from target
item 6 verifies cruiseControlRBTCovReqs.slreqx#5: DECREMENT: DECREMENT button decreases set speed