# Requirement set LiveDoc_Polarion-LVO_Matlab_Requirements_Cruise Control (R2024b)

Attributes:
- p_type: Imported from linktype_rmi_polarion:p_type
- rev: Imported from linktype_rmi_polarion:rev

## 1 [http://pl1chzrh0298nb/polarion/#/project/Matlab/wiki/Requirements/Cruise Control] References to Cruise Control (Container)
Read-only references to Polarion document.

### 1.1 [MATL-791] Cruise Control (Container)
p_type: heading
rev: 39483

#### 1.1.1 [MATL-777] Active Control (Container)
p_type: heading
rev: 39483

##### 1.1.1.1 [MATL-780] The system shall actively control the vehicle's speed to maintain the desired ta...
The system shall actively control the vehicle's speed to maintain the desired target speed.
p_type: System Requirement
rev: 39483

##### 1.1.1.2 [MATL-787] The system shall be able to accelerate or decelerate the vehicle as needed to re...
The system shall be able to accelerate or decelerate the vehicle as needed to reach and maintain the target speed.
p_type: System Requirement
rev: 39483

#### 1.1.2 [MATL-772] Target Speed: (Container)
p_type: heading
rev: 39483

##### 1.1.2.1 [MATL-782] The system shall allow the user to set a target speed for the vehicle.
p_type: System Requirement
rev: 39483

##### 1.1.2.2 [MATL-784] The system shall maintain the vehicle's speed at the user-specified target speed...
The system shall maintain the vehicle's speed at the user-specified target speed.
p_type: System Requirement
rev: 39483

#### 1.1.3 [MATL-774] Previous Target: (Container)
p_type: heading
rev: 39483

##### 1.1.3.1 [MATL-781] The system shall store the previous target speed set by the user.
p_type: System Requirement
rev: 39483

##### 1.1.3.2 [MATL-776] The system shall be able to revert to the previous target speed if needed.
p_type: System Requirement
rev: 39483

#### 1.1.4 [MATL-783] Active Last Step: (Container)
p_type: heading
rev: 39483

##### 1.1.4.1 [MATL-778] The system shall keep track of the last active control step, including the magni...
The system shall keep track of the last active control step, including the magnitude and direction of the control action.
p_type: System Requirement
rev: 39483

##### 1.1.4.2 [MATL-773] The system shall be able to reference the active last step for feedback and adju...
The system shall be able to reference the active last step for feedback and adjustment of the control algorithm.
p_type: System Requirement
rev: 39483

#### 1.1.5 [MATL-785] PI Controller: (Container)
p_type: heading
rev: 39483

##### 1.1.5.1 [MATL-775] The system shall use a Proportional-Integral (PI) controller to regulate the veh...
The system shall use a Proportional-Integral (PI) controller to regulate the vehicle's speed.
p_type: System Requirement
rev: 39483

##### 1.1.5.2 [MATL-788] The PI controller shall use the difference between the target speed and the actu...
The PI controller shall use the difference between the target speed and the actual vehicle speed as the error signal.
p_type: System Requirement
rev: 39483

##### 1.1.5.3 [MATL-789] The PI controller shall adjust the throttle or braking input to the vehicle to m...
The PI controller shall adjust the throttle or braking input to the vehicle to minimize the speed error.
p_type: System Requirement
rev: 39483

#### 1.1.6 [MATL-779] Control Active: (Container)
p_type: heading
rev: 39483

##### 1.1.6.1 [MATL-790] The system shall have a clear indication of when the cruise control is actively...
The system shall have a clear indication of when the cruise control is actively controlling the vehicle's speed.
p_type: System Requirement
rev: 39483

##### 1.1.6.2 [MATL-786] The system shall provide a way for the user to engage and disengage the cruise c...
The system shall provide a way for the user to engage and disengage the cruise control as needed.
p_type: System Requirement
rev: 39483