# Requirement set LiveDoc_Polarion-LVO_Simulink_Requirements_Cruise Control (R2024b)

Attributes:
- p_type: Imported from linktype_rmi_polarion:p_type
- rev: Imported from linktype_rmi_polarion:rev

## 1 [http://pl1chzrh0298nb/polarion/#/project/Simulink/wiki/Requirements/Cruise Control] References to Cruise Control (Container)
Read-only references to Polarion document.
Comment: There are no changes
Comment: There are no changes

### 1.1 [SIMU-546] Cruise Control (Container)
p_type: Heading
rev: 39487

#### 1.1.1 [SIMU-528] Active Control (Container)
p_type: Heading
rev: 39487

##### 1.1.1.1 [SIMU-540] The system shall actively control the vehicle's speed to maintain the desired ta...
The system shall actively control the vehicle's speed to maintain the desired target speed.
p_type: System Requirement
rev: 39487

##### 1.1.1.2 [SIMU-539] The system shall be able to accelerate or decelerate the vehicle as needed to re...
The system shall be able to accelerate or decelerate the vehicle as needed to reach and maintain the target speed.
p_type: System Requirement
rev: 39487

#### 1.1.2 [SIMU-527] Target Speed (Container)
p_type: Heading
rev: 39488

##### 1.1.2.1 [SIMU-531] The system shall allow the user to set a target speed for the vehicle.
p_type: System Requirement
rev: 39487

##### 1.1.2.2 [SIMU-534] The system shall maintain the vehicle's speed at the user-specified target speed...
The system shall maintain the vehicle's speed at the user-specified target speed.
p_type: System Requirement
rev: 39487

#### 1.1.3 [SIMU-530] Previous Target (Container)
p_type: Heading
rev: 39488

##### 1.1.3.1 [SIMU-533] The system shall store the previous target speed set by the user.
p_type: System Requirement
rev: 39487

##### 1.1.3.2 [SIMU-543] The system shall be able to revert to the previous target speed if needed.
p_type: System Requirement
rev: 39487

#### 1.1.4 [SIMU-529] Active Last Step (Container)
p_type: Heading
rev: 39488

##### 1.1.4.1 [SIMU-542] The system shall keep track of the last active control step, including the magni...
The system shall keep track of the last active control step, including the magnitude and direction of the control action.
p_type: System Requirement
rev: 39487

##### 1.1.4.2 [SIMU-545] The system shall be able to reference the active last step for feedback and adju...
The system shall be able to reference the active last step for feedback and adjustment of the control algorithm.
p_type: System Requirement
rev: 39487

#### 1.1.5 [SIMU-537] PI Controller (Container)
p_type: Heading
rev: 39488

##### 1.1.5.1 [SIMU-544] The system shall use a Proportional-Integral (PI) controller to regulate the veh...
The system shall use a Proportional-Integral (PI) controller to regulate the vehicle's speed.
p_type: System Requirement
rev: 39487

##### 1.1.5.2 [SIMU-538] The PI controller shall use the difference between the target speed and the actu...
The PI controller shall use the difference between the target speed and the actual vehicle speed as the error signal.
p_type: System Requirement
rev: 39487

##### 1.1.5.3 [SIMU-535] The PI controller shall adjust the throttle or braking input to the vehicle to m...
The PI controller shall adjust the throttle or braking input to the vehicle to minimize the speed error.
p_type: System Requirement
rev: 39487

#### 1.1.6 [SIMU-536] Control Active (Container)
p_type: Heading
rev: 39488

##### 1.1.6.1 [SIMU-541] The system shall have a clear indication of when the cruise control is actively...
The system shall have a clear indication of when the cruise control is actively controlling the vehicle's speed.
p_type: System Requirement
rev: 39487

##### 1.1.6.2 [SIMU-532] The system shall provide a way for the user to engage and disengage the cruise c...
The system shall provide a way for the user to engage and disengage the cruise control as needed.
p_type: System Requirement
rev: 39487